# Grasshopper definition ViewExport.gh (Grasshopper 1.0.7)
# plug-ins: Human, Sasquatch, Wombat

# ----
# Perkins & Will
# Title:
# Description:
# 
# Author(s):
# GH Version:
# Last Modified by:
# Last Modified Date:
# Required Plugins:
# Additional Assets Required:
# 
# Notes/Issues:
update_view = Button()
# Good Practice Guidelines
# 1. Divide the script into the user interface and the back end
# 2. Build the script with small groups of nodes
# 3. Groups should always have input/output
# 4. Rename the input/output containers to the data they carry
# 5. Color code groups according to categories in the template
# COMPONENT GROUPING
# INPUT
# CONTROL
# WORKING
# ANNOTATION
# OUTPUT
# VISUALIZATION
# Reference Scribble, copy me!
# Reference scribble, copy me!
reset_lists = Button()
viewports = ViewportProperties(Update=update_view, AutoUpdate=False)  # -> ViewportNames, ActiveViewportIndex, ViewportBounds, ViewportDisplayMode, CameraLocation, CameraTarget, CameraPlane, CameraLensLength, CameraProjection, CameraUp

item = ListItem(List=viewports.ViewportNames, Index=0, Wrap=True)
item_2 = ListItem(List=viewports.CameraLocation, Index=0, Wrap=True)
item_3 = ListItem(List=viewports.CameraTarget, Index=0, Wrap=True)
item_4 = ListItem(List=viewports.CameraLensLength, Index=0, Wrap=True)
record = RecordData(Data=item, Record=True, Reset=reset_lists, RecordFirstDataOnReset=False)
record_2 = RecordData(Data=item_2, Record=True, Reset=reset_lists, RecordFirstDataOnReset=False)
record_3 = RecordData(Data=item_3, Record=True, Reset=reset_lists, RecordFirstDataOnReset=False)
record_4 = RecordData(Data=item_4, Record=True, Reset=reset_lists, RecordFirstDataOnReset=False)
panel = Panel(record_2)
panel_2 = Panel(record_4)
panel_3 = Panel(record)
panel_4 = Panel(record_3)
dispatch = Dispatch(List=panel_3, DispatchPattern=[True, False])  # -> ListA, ListB
dispatch_2 = Dispatch(List=panel, DispatchPattern=[True, False])  # -> ListA, ListB
dispatch_3 = Dispatch(List=panel_4, DispatchPattern=[True, False])  # -> ListA, ListB
dispatch_4 = Dispatch(List=panel_2, DispatchPattern=[True, False])  # -> ListA, ListB
panel_5 = Panel(dispatch_2.ListA)
panel_6 = Panel(dispatch.ListA)
panel_7 = Panel(dispatch_3.ListA)
panel_8 = Panel(dispatch_4.ListA)

write_json = Button()

python = GhPythonScript(x=panel_6, y=panel_5, z=panel_7, u=panel_8)  # -> out, a; inputs x: list, y: list, z: list, u: list
# ---------- python: Python ----------
__author__ = "franklinw"
__version__ = "2024.07.16"

import rhinoscriptsyntax as rs
import json

class View:
    def __init__ (self, name, position, target, fov):
        self.name = name
        self.position = position
        self.target = target
        self.fov = fov

a = []
for idx, i in enumerate(x):
    view = View(x[idx], y[idx], z[idx], u[idx])
    n = json.dumps(view.__dict__)
    print(n)
    a.append(n)
# ---------- end python ----------
panel_9 = Panel("C:\Users\franklinw\OneDrive - Perkins and Will\Documents\Programming\2024\InteractiveDesignModels\assets\models\CameraPositions.json")
panel_10 = Panel(python.a)
path = FilePath(panel_9)
writetxt = WriteToTextFile(Run=write_json, TextToWrite=panel_10, FilePath=path, Append=False, NewOnly=False)
